# Grasshopper definition Sentiment Analysis Vertical Line.gh (Grasshopper 1.0.8)
# plug-ins: Human

file_path = FilePath("E:\PG\Semester 2\Final Review\前期分析\Google Sentiment\residents_emotion_smaller_scale.csv")
file_path_2 = FilePath("E:\PG\Semester 2\Final Review\前期分析\Google Sentiment\tourist_emotion_smaller_scale.csv")
read_file = ReadFile(File=file_path, PerLineParse=True)
cull_index = CullIndex(List=read_file, Indices=Slider(0, range=0..100), Wrap=True)
text_split = TextSplit(Text=cull_index, Separators=",")
text_split_2 = TextSplit(Text=read_file, Separators=",")
panel = Panel(text_split_2)
panel_2 = Panel(text_split)
list_item = ListItem(List=text_split, Index=Slider(6, range=0..50), Wrap=True)  # -> flatten(Item)
list_item_2 = ListItem(List=text_split, Index=Slider(2, range=0..10), Wrap=True)  # -> flatten(Item)
panel_3 = Panel(list_item_2)
list_item_3 = ListItem(List=text_split, Index=Slider(5, range=0..50), Wrap=True)  # -> flatten(Item)
get_number = GetNumber(list_item_3, AtLeast=1, AtMost=1, Maximum=1.797693135e+308, Minimum=-1.797693135e+308, TreeAccess=False)
get_number_2 = GetNumber(list_item, AtLeast=1, AtMost=1, Maximum=1.797693135e+308, Minimum=-1.797693135e+308, TreeAccess=False)
get_number_3 = GetNumber(list_item_2, AtLeast=1, AtMost=1, Maximum=1.797693135e+308, Minimum=-1.797693135e+308, TreeAccess=False)
bounds = Bounds(Numbers=get_number_3)
construct_point = ConstructPoint(XCoordinate=get_number, YCoordinate=get_number_2, ZCoordinate=0)
multiplication = Multiplication(A=get_number_3, B=Slider(5, range=0..100))
remap_numbers = RemapNumbers(Value=get_number_3, Source=bounds, Target=multiplication)  # -> Mapped, Clipped
panel_4 = Panel(multiplication)
unit_z = UnitZ(Factor=remap_numbers.Mapped)
move = Move(Geometry=construct_point, Motion=unit_z)  # -> Geometry, Transform
line = Line(StartPoint=construct_point, EndPoint=move.Geometry)
bake_geometry = BakeGeometry(Bake=Button(), Geometry=line, DeleteOldBakes=False, PreserveTrees=False)
