# Grasshopper definition Workshop Route Dataline.gh (Grasshopper 1.0.8)
# plug-ins: Human

file_path = FilePath("E:\PG\Semester 2\Skills Module\Github上传文件\4_gps_generated_3857.csv")
read_file = ReadFile(File=file_path, PerLineParse=True)
tab = Panel(",")
cull_index = CullIndex(List=read_file, Indices="0", Wrap=True)
number_slider = Slider(5, range=0..100)
text_split = TextSplit(Text=cull_index, Separators=tab)
list_item = ListItem(List=text_split, Index=Slider(6, range=0..100), Wrap=True)  # -> flatten(Item)
panel = Panel(list_item)
panel_2 = Panel(text_split)

list_item_2 = ListItem(List=panel_2, Index=Slider(26, range=0..100), Wrap=True)  # -> flatten(Item), Item1
list_item_3 = ListItem(List=panel_2, Index=Slider(27, range=0..100), Wrap=True)  # -> flatten(Item), Item1
construct_point = ConstructPoint(XCoordinate=list_item_2.Item, YCoordinate=list_item_3.Item, ZCoordinate=0)

get_number = GetNumber(panel, AtLeast=1, AtMost=1, Maximum=1.797693135e+308, Minimum=-1.797693135e+308, TreeAccess=False)

bounds = Bounds(Numbers=get_number)
construct_domain = ConstructDomain(DomainStart=Slider(50, range=-500..501), DomainEnd=Slider(250, range=0..10000))
multiplication = Multiplication(A=Slider(0.5, range=0..1), B=get_number)
remap_numbers = RemapNumbers(Value=get_number, Source=bounds, Target=construct_domain)  # -> Mapped, Clipped

panel_3 = Panel(list_item_2.Item)
unit_z = UnitZ(Factor=remap_numbers.Mapped)
point = Point(construct_point)
move = Move(Geometry=point, Motion=unit_z)  # -> Geometry, Transform

# ----
# Reading textfiles (with Grasshopper)
line = Line(StartPoint=point, EndPoint=move.Geometry)
bake_geometry = BakeGeometry(Bake=Button(), Geometry=flatten(line), DeleteOldBakes=False, PreserveTrees=False)

polyline = PolyLine(Vertices=move.Geometry, Closed=False)
bake_geometry_2 = BakeGeometry(Bake=Button(), Geometry=flatten(polyline), DeleteOldBakes=False, PreserveTrees=False)

get_number_2 = GetNumber(AtLeast=1, AtMost=1, Maximum=1.797693135e+308, Minimum=-1.797693135e+308, TreeAccess=False)
construct_domain_2 = ConstructDomain(DomainStart=Slider(0.5, range=0..1), DomainEnd=Slider(4.5, range=0..10))
bounds_2 = Bounds(Numbers=get_number_2)
remap_numbers_2 = RemapNumbers(Value=get_number_2, Source=bounds_2, Target=construct_domain_2)  # -> Mapped, Clipped
